# Dynamo graph Table.dyn (Dynamo 2.10.1.3976)

views = Views("TABELA TESTE")
watch = Watch(views)
current = Document.Current()
python_script = Python(IN[0]=views, IN[1]=current)  # IronPython2
# ---------- python_script.python (26 lines) ----------
# Carregar as bibliotecas DesignScript e padrão do Python
import sys
import clr
clr.AddReference('ProtoGeometry')
from Autodesk.DesignScript.Geometry import *

clr.AddReference('RevitAPI')
import Autodesk
from Autodesk.Revit.DB import Transaction

clr.AddReference("RevitServices")
import RevitServices
from RevitServices.Persistence import DocumentManager
doc = DocumentManager.Instance.CurrentDBDocument

t = Transaction(doc, 'Name')
t.Start()
t.Commit()

element = UnwrapElement(IN[0])

table_data = element.GetTableData()
table_data.GetSectionData(0).InsertColumn(1)


OUT = 0
# ----------------------------------------
watch_2 = Watch(python_script)
